# Grasshopper definition wrapper4.ghx (Grasshopper 1.0.7)

mesh = Mesh([<mesh referenced from the Rhino model> x138])
mjoin = MeshJoin(Meshes=mesh)

# ---- group: Point settings
number_slider = Slider(0.5, range=0..1)
number_slider_2 = Slider(0.5, range=0..1)
number_slider_3 = Slider(0.5, range=0..1)

# ---- group: Line settings
number_slider_4 = Slider(0.5, range=0..1)

# ---- group: finess
number_slider_5 = Slider(30, range=5..1000)

# ---- group: point or line
toggle = BooleanToggle(True)

# ---- group: BASE MESH
mesh_2 = Mesh(mjoin)

# ----
bbox = BoundingBox(Content=mesh_2, Plane=PlaneXY(0, 0, 0))  # -> Box, Box_2
box = EvaluateBox(Box=bbox.Box_2, UParameter=number_slider_2, VParameter=number_slider_3, WParameter=number_slider)  # -> Plane, Point, Include
pt = Point(box.Point)
volume = Volume(Geometry=bbox.Box_2)  # -> Volume, Centroid
debox = DeconstructBox(Box=bbox.Box_2)  # -> Plane, X, Y, Z
scale = Scale(Geometry=bbox.Box_2, Center=volume.Centroid, Factor=Slider(1.1, range=0.5..1.5))  # -> Geometry, Transform
dedomain = DeconstructDomain(Domain=debox.Z)  # -> Start, End
dedomain_2 = DeconstructDomain(Domain=debox.Y)  # -> Start, End
dedomain_3 = DeconstructDomain(Domain=debox.X)  # -> Start, End
subtraction = Subtraction(A=dedomain_3.Start, B=dedomain_3.End)
subtraction_2 = Subtraction(A=dedomain_2.Start, B=dedomain_2.End)
debox_2 = DeconstructBox(Box=scale.Geometry)  # -> Plane, X, Y, Z
debrep = DeconstructBrep(Brep=bbox.Box_2)  # -> Faces, Edges, Vertices
subtraction_3 = Subtraction(A=dedomain.Start, B=dedomain.End)
num = Number(Slider(60, range=0..150))
num_2 = Number(debox_2.X)
num_3 = Number(debox_2.Z)
num_4 = Number(debox_2.Y)
item = ListItem(List=debrep.Faces, Index=0, Wrap=True)  # -> Item, Item1, Item2, Item3, Item4, Item5
abs = Absolute(Value=subtraction)
area = Area(Geometry=debrep.Faces)  # -> Area, Centroid; disabled
sort = SortList(Keys=[num_2, num_4, num_3])  # -> reverse(Keys), ValuesA
abs_2 = Absolute(Value=subtraction_2)
abs_3 = Absolute(Value=subtraction_3)
sort_2 = SortList(Keys=area.Area, ValuesA=debrep.Faces)  # -> Keys, ValuesA; disabled
area_2 = Area(Geometry=item.Item)  # -> Area, Centroid
area_3 = Area(Geometry=item.Item2)  # -> Area, Centroid
item_2 = ListItem(List=sort.Keys, Index=0, Wrap=True)
max = Maximum(A=abs, B=abs_2)
item_3 = ListItem(List=sort_2.ValuesA, Index=0, Wrap=True)  # -> Item, Item1, Item2, Item3; disabled
item_4 = ListItem(List=debrep.Vertices, Index=0, Wrap=True)
division = Division(A=abs, B=num)
division_2 = Division(A=abs_3, B=num)
division_3 = Division(A=abs_2, B=num)
ln = Line(StartPoint=area_2.Centroid, EndPoint=area_3.Centroid)
curvepoint = PointOnCurve(ln, parameter=0.5)
max_2 = Maximum(A=max, B=abs_3)
box_2 = DomainBox(Base=item_4, X=division, Y=division_3, Z=division_2)
srf = Surface(item_3.Item)  # disabled
srf_2 = Surface(item_3.Item2)  # disabled
division_4 = Division(A=max_2, B=number_slider_5)
volume_2 = Volume(Geometry=box_2)  # -> Volume, Centroid
scale_2 = Scale(Geometry=ln, Center=curvepoint, Factor=number_slider_4)  # -> Geometry, Transform
geo = Geometry(mesh_2)
arrbox = BoxArray(Geometry=volume_2.Centroid, Cell=box_2, XCount=num, YCount=num, ZCount=num)  # -> simplify(Geometry), Transform
brep = Brep(scale.Geometry)
smesh = SimpleMesh(Brep=box_2)  # disabled
meshcp = MeshClosestPoint(Point=arrbox.Geometry, Mesh=geo)  # -> Point, Index, Parameter; disabled
number_slider_6 = Slider(230, range=0..1000)
dist = Distance(PointA=arrbox.Geometry, PointB=meshcp.Point)  # disabled
custom_mesh_settings = SettingsCustom(
    StitchSeams=True,
    SimplePlanes=False,
    Refine=True,
    MinCount=16,
    MaxCount=400,
    AspectRatio=20,
    MaxDistance=0,
    MaxAngle=20,
    MinEdge=0,
    MaxEdge=division_4)
number_slider_7 = Slider(50, range=0..100)  # disabled
number_slider_8 = Slider(50, range=0..100)  # disabled
number_slider_9 = Slider(50, range=0..100)  # disabled
sort_3 = SortList(Keys=[division_3, division, division_2])  # -> reverse(Keys), ValuesA; disabled
number_slider_10 = Slider(50, range=0..100)  # disabled
colom = CollisionOneMany(Obstacles=geo)  # -> Collision, Index; disabled
item_5 = ListItem(List=sort_3.Keys, Index=0, Wrap=True)  # disabled
cull = CullPattern(List=arrbox.Geometry, CullPattern=colom.Collision)  # -> flatten(List); disabled
num_5 = Number(item_5)  # disabled
larger = LargerThan(FirstNumber=dist, SecondNumber=num_5)  # -> LargerThan, OrEqualTo; disabled
cull_2 = CullPattern(List=arrbox.Geometry, CullPattern=invert(larger.LargerThan))  # disabled
volume_3 = Volume(Geometry=cull)  # -> Volume, Centroid; disabled
mesh_3 = MeshBrep(Brep=brep, Settings=custom_mesh_settings)
vec2pt = Vector2Pt(PointA=volume_2.Centroid, PointB=cull_2, Unitize=False)  # -> Vector, Length; disabled
msphere = MeshSphere(Base=pt, Radius=item_2, UCount=number_slider_6, VCount=number_slider_6)
sdivide = DivideSurface(Surface=srf, UCount=number_slider_9, VCount=number_slider_7)  # -> Points, Normals, Parameters; disabled
sdivide_2 = DivideSurface(Surface=srf_2, UCount=number_slider_10, VCount=number_slider_8)  # -> Points, Normals, Parameters; disabled
move = Move(Geometry=smesh, Motion=vec2pt.Vector)  # -> Geometry, Transform; disabled
tri = Triangulate(Mesh=mesh_3)  # -> Mesh, Count
tri_2 = Triangulate(Mesh=msphere)  # -> Mesh, Count
crv = Curve(scale_2.Geometry)
rev = Reverse(Vector=sdivide.Normals)  # disabled
faceb = FaceBoundaries(Mesh=tri.Mesh)
rev_2 = Reverse(Vector=sdivide_2.Normals)  # disabled
faceb_2 = FaceBoundaries(Mesh=move.Geometry)  # -> flatten(Boundaries); disabled
project = ProjectPoint(Point=sdivide.Points, Direction=rev, Geometry=mesh_2)  # -> Point, Index; disabled
project_2 = ProjectPoint(Point=sdivide_2.Points, Direction=rev_2, Geometry=mesh_2)  # -> Point, Index; disabled
mesh_4 = Mesh(tri.Mesh)
pcen = PolygonCenter(Polyline=faceb_2)  # -> CenterV, CenterE, CenterA; disabled
pt_2 = Point(flatten([project.Point, project_2.Point]))  # disabled
demesh = DeconstructMesh(Mesh=mesh_4)  # -> Vertices, Faces, Colours, Normals
null = NullItem(Item=pt_2)  # -> NullFlags, InvalidFlags, Description; disabled
cullpt = CullDuplicates(Points=pcen.CenterV, Tolerance=0.1, CullMode=2)  # -> Points, simplify(Indices), Valence; disabled
cull_3 = CullPattern(List=pt_2, CullPattern=invert(null.NullFlags))  # disabled
sort_pt = SortPoints(Points=cull_3)  # -> Points, Indices; disabled
number_slider_11 = Slider(3, range=0..10)  # disabled
crv_cp = CurveClosestPoint(Point=demesh.Vertices, Curve=crv)  # -> Point, Parameter, Distance
lng = ListLength(List=crv_cp.Point)
repeat = RepeatData(Data=toggle, Length=lng)
item_6 = ListItem(List=faceb_2, Index=cullpt.Indices, Wrap=True)  # disabled
prox = Proximity3D(Points=sort_pt.Points, Group=number_slider_11)  # -> Links, Topology; disabled

# ---- group: Uneeded checkers
cullpt_2 = CullDuplicates(Points=demesh.Vertices, Tolerance=0.1, CullMode=3)  # -> Points, Indices, Valence

# ----
p_n_c = PickNChoose(Pattern=repeat, Stream0=pt, Stream1=crv_cp.Point)
curvepoint_2 = PointOnCurve(prox.Links, parameter=0.5)  # disabled
null_2 = NullItem(Item=p_n_c)  # -> NullFlags, InvalidFlags, Description
cull_4 = CullPattern(List=p_n_c, CullPattern=invert(null_2.NullFlags))
pt_3 = Point(simplify(curvepoint_2))  # disabled

# ---- group: Uneeded checkers
faceb_3 = FaceBoundaries(Mesh=mesh_4)
explode = Explode(Curve=faceb_3, Recursive=True)  # -> Segments, Vertices

# ----
ln_2 = Line(StartPoint=demesh.Vertices, EndPoint=cull_4)
plfit = PlaneFit(Points=pt_3)  # -> Plane, Deviation; disabled
panel = Panel(pt_3)  # disabled
vec = Vector(ln_2)
cir = Circle(Plane=PlaneXY(0, 0, 0), Radius=1)  # disabled

# ---- group: checker
vdis = VectorDisplay(Anchor=demesh.Vertices, Vector=vec)

# ----
project_3 = ProjectPoint(Point=demesh.Vertices, Direction=vec, Geometry=mesh_2)  # -> simplify(Point), Index
mcx = MeshCurve(Mesh=mesh_2, Curve=graft(ln_2))  # -> Points, Faces
alongcrv = SortAlongCurve(Points=pt_3, Curve=cir)  # -> Points, Indices; disabled
toggle_2 = BooleanToggle(True)  # disabled
panel_2 = Panel(alongcrv.Points)  # disabled
alongcrv_2 = SortAlongCurve(Points=mcx.Points, Curve=graft(ln_2))  # -> Points, Indices

# ---- group: Uneeded checkers
pline = PolyLine(Vertices=project_3.Point, Closed=Toggle(True))

# ----
pline_2 = PolyLine(Vertices=alongcrv.Points, Closed=toggle_2)  # disabled
pt_4 = Point(flatten(alongcrv_2.Points))
nullrep = ReplaceNulls(Items=project_3.Point, Replacements=pt)  # -> Items, Count

# ---- group: Uneeded checkers
boundary = BoundarySurfaces(Edges=pline)
join = BrepJoin(Breps=flatten(boundary))  # -> Breps, Closed
mesh_5 = MeshBrep(
    Brep=join.Breps,
    Settings={GridMaxCount=0, GridMinCount=16, JaggedSeams=False, MaxEdgeLength=0, MinEdgeLength=0.0001, MinTolerance=0, Refine=True, RefineAngle=0, RelativeTolerance=0.65, SimplePlanes=True, Tolerance=0})

# ----
panel_3 = Panel(cull_4)

# ---- group: Unsmoothen output
conmesh = ConstructMesh(Vertices=nullrep.Items, Faces=demesh.Faces)  # -> simplify(Mesh); disabled

# ---- group: Uneeded checkers
Z = UnitZ(Factor=Slider(18, range=0..100))
move_2 = Move(Geometry=conmesh, Motion=Z)  # -> Geometry, Transform

# ----
number_slider_12 = Slider(0.3, range=0..1)  # disabled
number_slider_13 = Slider(2, range=0..100)  # disabled

# ---- group: Smoothen OUTPUT
msmooth = SmoothMesh(Mesh=conmesh, Strength=number_slider_12, SkipNaked=True, Iterations=number_slider_13)  # disabled
